# Grasshopper definition 4 Wheeled Cupola Cart WSII 001.gh (Grasshopper 1.0.7)

# ----
# Single Well for Cupola Wagon
# Tap and Well Holes
number_slider = Slider(3, range=2..8)
height = Slider(10, range=5..10)
tap_hole = Slider(2, range=1..2)
tap_hole_2 = Slider(7, range=6..7)
int = Integer(90)
xz = XZPlane(Origin=Point(0, 0, 0))
rad = Radians(Degrees=int)
xy = XYPlane(Origin=Point(0, 0, 0))
Z = UnitZ(Factor=number_slider)
cyl = Cylinder(Base=PlaneXY(0, 0, 0), Radius=tap_hole_2, Length=Slider(16, range=1..16))
cyl_2 = Cylinder(Base=PlaneXY(0, 0, 0), Radius=tap_hole, Length=Slider(16, range=1..16))
cyl_3 = Cylinder(Base=PlaneXY(0, 0, 0), Radius=Slider(8, range=6..8), Length=height)
cap = CapHoles(Brep=cyl)
cap_2 = CapHoles(Brep=cyl_3)
cap_3 = CapHoles(Brep=cyl_2)
rot3d = Rotate3D(Geometry=cap_3, Angle=rad, Center=Point(0, 0, 0), Axis=xz)  # -> Geometry, Transform
rot3d_2 = Rotate3D(Geometry=rot3d.Geometry, Angle=rad, Center=Point(0, 0, 0), Axis=xy)  # -> Geometry, Transform
move = Move(Geometry=rot3d_2.Geometry, Motion=Z)  # -> Geometry, Transform
sdiff = SolidDifference(BrepsA=cap_2, BrepsB=cap)

# ----
# Wheels
number_slider_2 = Slider(10, range=0..10)
# Holes
number_slider_3 = Slider(2, range=1..2)
number_slider_4 = Slider(8, range=0..10)
# Hole Distance from Center of Wheel
number_slider_5 = Slider(6, range=4..7)
number_slider_6 = Slider(2, range=0..10)
# # of Holes
number_slider_7 = Slider(7, range=2..10)
X = UnitX(Factor=number_slider_5)
cyl_4 = Cylinder(Base=PlaneXY(0, 0, 0), Radius=number_slider_2, Length=number_slider_6)
cyl_5 = Cylinder(Base=PlaneXY(0, 0, 0), Radius=number_slider_3, Length=number_slider_6)
cap_4 = CapHoles(Brep=cyl_4)
cap_5 = CapHoles(Brep=cyl_5)
move_2 = Move(Geometry=cap_5, Motion=X)  # -> Geometry, Transform
arrpolar = PolarArray(Geometry=move_2.Geometry, Plane=PlaneXY(0, 0, 0), Count=number_slider_7, Angle=6.283185307)  # -> Geometry, Transform
sdiff_2 = SolidDifference(BrepsA=cap_4, BrepsB=arrpolar.Geometry)

# ----
# Angle of Wheels
number_slider_8 = Slider(1.779, range=1.5..2)
# Spacing of Wheels
number_slider_9 = Slider(8, range=2..10)
Y = UnitY(Factor=1)
Y_2 = UnitY(Factor=1)
neg = Negative(Value=Y)
rot3d_3 = Rotate3D(Geometry=sdiff_2, Angle=number_slider_8, Center=Point(0, 0, 0), Axis=Y_2)  # -> Geometry, Transform
rot3d_4 = Rotate3D(Geometry=sdiff_2, Angle=number_slider_8, Center=Point(0, 0, 0), Axis=neg)  # -> Geometry, Transform
X_2 = UnitX(Factor=number_slider_9)
X_3 = UnitX(Factor=number_slider_9)
neg_2 = Negative(Value=X_2)
# Two Wheels
move_3 = Move(Geometry=rot3d_3.Geometry, Motion=X_3)  # -> Geometry, Transform
move_4 = Move(Geometry=rot3d_4.Geometry, Motion=neg_2)  # -> Geometry, Transform

# ---- group: Cupola Well
sdiff_3 = SolidDifference(BrepsA=sdiff, BrepsB=move.Geometry)

# ----
gmerge = MergeGroup(GroupA=move_3.Geometry, GroupB=move_4.Geometry)

# ---- group: the Wheels
gmerge_2 = MergeGroup(GroupA=move_3.Geometry, GroupB=move_4.Geometry)

# ----
Y_3 = UnitY(Factor=Slider(24, range=24..48))
merge = Merge(Data1=gmerge_2, Data2=gmerge)
move_5 = Move(Geometry=merge, Motion=Y_3)  # -> Geometry, Transform

# ---- group: 4 Wheels
# Four Wheels
merge_2 = Merge(Data1=merge, Data2=move_5.Geometry)
