# Grasshopper definition Attraction and Repulsion KCAI 007.gh (Grasshopper 1.0.7)

# could we deform a grid by points that are "megnetic"?
# we have learned:
# Vectors, points, planes, fields and grids
# Point charges to creat field
# note force arrows in rhino
# Polygon Center
# change construction plane in Display/preview plane size/radius
# Evaluate Field
# and
# Merge Fields
# then scale from Geo and Center?
# 
# Most Importantly Remapping Block!
# 
# Bounds
# Flatten data tree of strenght
# 
# The Graph Mapper
# change to Bezier
# Planar Surface/Boundary Surface
pt = Point([<point referenced from the Rhino model> x5])

# ---- group: Square Grid
sqgrid = Square(Plane=PlaneXY(0, 0, 0), Size=1, ExtentX=5, ExtentY=5)  # -> Cells, Points

# ---- group: Hexgrid
hexgrid = Hexagonal(Plane=PlaneXY(0, 0, 0), Size=1, ExtentX=Slider(15, range=0..100), ExtentY=Slider(10, range=0..100))  # -> Cells, Points

# ----
pcharge = PointCharge(Point=pt, Charge=1, Decay=2)

# ---- group: Cell Center
pcen = PolygonCenter(Polyline=hexgrid.Cells)  # -> CenterV, CenterE, CenterA

# ----
mergef = MergeFields(Fields=pcharge)

# ---- group: Factors for Scaling / evaluate the point, the center from edges
evf = EvaluateField(Field=mergef, Point=pcen.CenterE)  # -> Tensor, Strength

# ---- group: Factors for Scaling
bnd = Bounds(Numbers=flatten(evf.Strength))
dom = ConstructDomain(DomainStart=Slider(0.199, range=0..1), DomainEnd=Slider(1, range=0..1))
remap = RemapNumbers(Value=evf.Strength, Source=bnd, Target=dom)  # -> Mapped, Clipped

# ----
graph = GraphMapper(
    remap.Mapped,
    x0=0,
    x1=1,
    y0=0,
    y1=1,
    container_name="Bezier",
    cpx=[0, 0.592848599, 0.2297133356, 1],
    cpy=[0, 0.2346346378, 0.7611800432, 0.9750724435])
scale = Scale(Geometry=hexgrid.Cells, Center=pcen.CenterE, Factor=graph)  # -> Geometry, Transform
boundary = BoundarySurfaces(Edges=scale.Geometry)
