# Grasshopper definition Create Surfaces.gh (Grasshopper 1.0.7)

number_slider = Slider(11, range=0..100)
crv = Curve(<curve referenced from the Rhino model>)
crv_2 = Curve(<curve referenced from the Rhino model>)
crv_3 = Curve(<curve referenced from the Rhino model>)
pt = ConstructPoint(XCoordinate=number_slider, YCoordinate=number_slider, ZCoordinate=number_slider)
sumsrf = SumSurface(CurveA=crv_2, CurveB=crv)
fpatch = FragmentPatch(Boundary=crv_3)
rec_2pt = Rectangle2Pt(Plane=PlaneXY(0, 0, 0), PointA=Point(0, 0, 0), PointB=pt, Radius=0)  # -> Rectangle, Length
crv_4 = Curve(<curve referenced from the Rhino model>)
explode = Explode(Curve=rec_2pt.Rectangle, Recursive=True)  # -> Segments, Vertices
Z = UnitZ(Factor=Slider(23, range=0..100))
item = ListItem(List=explode.Vertices, Index=0, Wrap=True)  # -> Item, Item1, Item2, Item3
boundary = BoundarySurfaces(Edges=crv_4)
extr = Extrude(Base=crv_4, Direction=Z)
move = Move(Geometry=item.Item1, Motion=Vector(0, 0, 10))  # -> Geometry, Transform
move_2 = Move(Geometry=item.Item3, Motion=Vector(0, 0, 10))  # -> Geometry, Transform
cap = CapHoles(Brep=extr)
srf4pt = _4PointSurface(CornerA=item.Item, CornerB=move.Geometry, CornerC=item.Item2, CornerD=move_2.Geometry)
panel = Panel(srf4pt)
