# Grasshopper definition CreateLists006.gh (Grasshopper 1.0.7)

number_slider = Slider(5, range=0..10)
crv = Curve(<curve referenced from the Rhino model>)
geo = Geometry(<brep referenced from the Rhino model>)
divide = DivideCurve(Curve=crv, Count=Slider(5, range=0..10), Kinks=False)  # -> Points, Tangents, Parameters
debrep = DeconstructBrep(Brep=geo)  # -> Faces, Edges, Vertices
pline = PolyLine(Vertices=divide.Points, Closed=False)
dom = ConstructDomain(DomainStart=Slider(0, range=0..10), DomainEnd=Slider(10, range=0..10))
series = Series(Start=Slider(0, range=0..10), Step=Slider(9, range=0..10), Count=Slider(5, range=0..10))
range = Range(Domain=dom, Steps=Slider(9, range=0..10))
explode = Explode(Curve=pline, Recursive=True)  # -> Segments, Vertices
item = ListItem(List=debrep.Vertices, Index=0, Wrap=True)  # -> Item, Item1, Item2, Item3
Z = UnitZ(Factor=Slider(5, range=0..10))
panel = Panel(range)
panel_2 = Panel(debrep.Edges)
extr = Extrude(Base=explode.Segments, Direction=Z)
ln = Line(StartPoint=item.Item, EndPoint=item.Item2)
ln_2 = Line(StartPoint=item.Item1, EndPoint=item.Item3)
arrlinear = LinearArray(Geometry=extr, Direction=Z, Count=Slider(5, range=0..10))  # -> Geometry, Transform
panel_3 = Panel(divide.Points)
lng = ListLength(List=panel)
panel_4 = Panel("""2
35
7.8
42""")
panel_5 = Panel(lng)
random = Random(Range=Domain(0, 1), Number=1, Seed=2)
