# Grasshopper definition Curves KCAI 003.gh (Grasshopper 1.0.7)

# Set Plane and Origin
# Construction Planes
# Input location of Origin
# Panels for #'s
# Multiline Data Off
# Rhino Grid Show No
# How to move Construction Plane with Point
number_slider = Slider(10, range=0..10)
pt = Point(<point referenced from the Rhino model>)
xy = XYPlane(Origin=pt)
rectangle = Rectangle(Plane=xy, XSize=Slider(10, range=0..10), YSize=Slider(10, range=0..10), Radius="0")  # -> Rectangle, Length
panel = Panel(rectangle.Rectangle)
viewer = ParamViewer(rectangle.Rectangle)
