# Grasshopper definition Data Structures.gh (Grasshopper 1.0.7)

crv = Curve([<curve referenced from the Rhino model> x3])
crv_2 = Curve([<curve referenced from the Rhino model> x3])
crv_3 = Curve([<curve referenced from the Rhino model> x3])
crv_4 = Curve([<curve referenced from the Rhino model> x3])
divide = DivideCurve(Curve=crv, Count=10, Kinks=False)  # -> Points, Tangents, Parameters
divide_2 = DivideCurve(Curve=crv_2, Count=10, Kinks=False)  # -> Points, Tangents, Parameters
item = ListItem(List=crv_3, Index=0, Wrap=True)
series = Series(Start=0, Step=Slider(10, range=0..10), Count=10)
viewer = ParamViewer(divide_2.Points)
viewer_2 = ParamViewer(divide.Points)
ln = Line(StartPoint=divide.Points, EndPoint=divide_2.Points)
pt = ConstructPoint(XCoordinate=graft(series), YCoordinate=series, ZCoordinate=0)
panel = Panel(pt)
