# Grasshopper definition Domains.gh (Grasshopper 1.0.7)

dom = ConstructDomain(DomainStart=Slider(0, range=0..100), DomainEnd=Slider(100, range=0..100))
crv = Curve(<curve referenced from the Rhino model>)
range = Range(Domain=dom, Steps=Slider(20, range=0..100))
pt = ConstructPoint(XCoordinate=graft(range), YCoordinate=range, ZCoordinate=0)  # -> flatten(Point)
crv_cp = CurveClosestPoint(Point=pt, Curve=crv)  # -> Point, Parameter, Distance
bnd = Bounds(Numbers=crv_cp.Distance)
dom_2 = ConstructDomain(DomainStart=0, DomainEnd=1)
panel = Panel(pt)
remap = RemapNumbers(Value=crv_cp.Distance, Source=bnd, Target=dom_2)  # -> Mapped, Clipped
gradient = Gradient(
    LowerLimit=crv_cp.Distance,
    UpperLimit=bnd,
    Parameter=remap.Mapped,
    stops=[0: RGB(234, 38, 0), 0.25: RGB(234, 126, 0), 0.5: RGB(254, 244, 84), 0.75: RGB(173, 203, 249), 1: RGB(75, 107, 169)])
dom_3 = ConstructDomain(DomainStart=Slider(2, range=0..100), DomainEnd=Slider(0, range=0..10))
remap_2 = RemapNumbers(Value=crv_cp.Distance, Source=bnd, Target=dom_3)  # -> Mapped, Clipped
cir = Circle(Plane=pt, Radius=remap_2.Mapped)
panel_2 = Panel(remap.Mapped)
boundary = BoundarySurfaces(Edges=cir)
preview = CustomPreview(Geometry=boundary, Material=gradient)
