# Grasshopper definition Excercise002.gh (Grasshopper 1.0.7)

zpos = Slider(0.1, range=0.1..3)
ypos = Slider(6.54, range=0.1..26)
xpos = Slider(2.55, range=0..5)
pt = ConstructPoint(XCoordinate=xpos, YCoordinate=ypos, ZCoordinate=zpos)
pt_2 = Point(Point(10.07807884, 10.01547523, 0))
ln = Line(StartPoint=pt_2, EndPoint=pt)
