# Grasshopper definition Exercise001.gh (Grasshopper 1.0.7)

pt = Point(<point referenced from the Rhino model>)
pt_2 = Point(<point referenced from the Rhino model>)
pt_3 = Point(<point referenced from the Rhino model>)
pt_4 = Point(<point referenced from the Rhino model>)
srf4pt = _4PointSurface(CornerA=pt_2, CornerB=pt_3, CornerC=pt, CornerD=pt_4)
sdivide = DivideSurface(Surface=srf4pt, UCount=10, VCount=10)  # -> Points, Normals, Parameters
Z = UnitZ(Factor=Slider(3.371, range=0..9))
move = Move(Geometry=sdivide.Points, Motion=Z)  # -> Geometry, Transform
ln = Line(StartPoint=sdivide.Points, EndPoint=move.Geometry)
