# Grasshopper definition Exercise003.gh (Grasshopper 1.0.7)

number_slider = Slider(0, range=0..1)
pt = Point(Point(2.008092548, 0, 0))
xy = XYPlane(Origin=pt)
rectangle = Rectangle(Plane=xy, XSize=Slider(1, range=0..1), YSize=Slider(1, range=0..1), Radius="0")  # -> Rectangle, Length
panel = Panel(rectangle.Rectangle)
