# Grasshopper definition Exercise004.gh (Grasshopper 1.0.7)

length = Slider(9, range=1..12)
offset = Slider(6, range=0..12)

# ---- group: Origin
pt = Point(Point(2.050006246, 1.409379294, 0))

# ----
Y = UnitY(Factor=length)

# ---- group: Moved Point
move = Move(Geometry=pt, Motion=Y)  # -> Geometry, Transform

# ----
X = UnitX(Factor=offset)
nyumsegments = Slider(10, range=1..40)
nyumsegments_2 = Slider(3, range=1..40)

# ---- group: lineA
ln = Line(StartPoint=pt, EndPoint=move.Geometry)

# ---- group: lineB
move_2 = Move(Geometry=ln, Motion=X)  # -> Geometry, Transform

# ----
divide = DivideCurve(Curve=ln, Count=nyumsegments, Kinks=False)  # -> Points, Tangents, Parameters
divide_2 = DivideCurve(Curve=move_2.Geometry, Count=nyumsegments_2, Kinks=False)  # -> Points, Tangents, Parameters
long = LongestList(ListA=divide.Points, ListB=divide_2.Points, PaddingMode=2)  # -> ListA, ListB
short = ShortestList(ListA=divide.Points, ListB=divide_2.Points, TrimMode=2)  # -> ListA, ListB
crossref = CrossReference(ListA=divide.Points, ListB=divide_2.Points, CrossMode=1)  # -> ListA, ListB
ln_2 = Line(StartPoint=crossref.ListA, EndPoint=crossref.ListB)
panel = Panel(ln_2)
