# Grasshopper definition Exercise005.gh (Grasshopper 1.0.7)

# ---- group: t
range = Range(Domain=Slider(18, range=0..18), Steps=Slider(40, range=1..40))

# ----
sin = Sine(Value=range)
cos = Cosine(Value=range)
nyumsegments = Slider(1, range=1..40)
pt = ConstructPoint(XCoordinate=range, YCoordinate=sin, ZCoordinate=cos)
nurbs = NurbsCurve(Vertices=pt, Degree=3, Periodic=False)  # -> Curve, Length, Domain
