# Grasshopper definition Exercise006.gh (Grasshopper 1.0.7)

numturns = Slider(3, range=1..4)
numpoints = Slider(146, range=10..200)
zrotation = Slider(41.5, range=0..80)
pi = Pi(Factor=numturns)
rad = Radians(Degrees=zrotation)
range = Range(Domain=pi, Steps=numpoints)
phi = GoldenRatio(Factor=range)
panel = Panel(range)
pt = PointPolar(BasePlane=PlaneXY(0, 0, 0), XYAngle=range, ZAngle=0, Offset=phi)
pt_2 = PointPolar(BasePlane=PlaneXY(0, 0, 0), XYAngle=range, ZAngle=rad, Offset=phi)
ln = Line(StartPoint=pt, EndPoint=pt_2)
loft = Loft(Curves=ln, Options={Adjust=False, Closed=False, LoftEnds=0, LoftSimp=0, LoftType=0, Rebuild=10, Refit=0.01})
