# Grasshopper definition Exercise008.gh (Grasshopper 1.0.7)

numpts = Slider(158, range=1..200)

# ---- group: t
series = Series(Start=0, Step=1, Count=numpts)

# ----
expression = Expression(t=series, Expression="cos(t)*t")
expression_2 = Expression(t=series, Expression="sin(t)*t")
panel = Panel("""true
true
false
false""")
panel_2 = Panel("true")
panel_3 = Panel("""true
true
true
false
false
true
false""")
pt = ConstructPoint(XCoordinate=expression, YCoordinate=expression_2, ZCoordinate=0)
weave = Weave(Pattern=[0, 1], NullGaps=False)
dispatch = Dispatch(DispatchPattern=[True, False])  # -> ListA, ListB

# ---- group: Culled List of Points
cull = CullPattern(List=pt, CullPattern=panel)

# ----
points = PointList(Points=pt)

# ---- group: gate tools, several of them to view
or = GateOr()

# ----
voronoi = Voronoi(Points=cull, Radius=Slider(40, range=0..40), BruteForceOverride=False)
