# Grasshopper definition GH 04 - Curve Functionality.gh (Grasshopper 1.0.7)

number_slider = Slider(8, range=0..100)
number_slider_2 = Slider(0.56, range=0..1)
crv = Curve(reparameterize(<curve referenced from the Rhino model>))
crv_2 = Curve(<curve referenced from the Rhino model>)
divide = DivideCurve(Curve=crv, Count=number_slider, Kinks=False)  # -> Points, Tangents, Parameters
divide_2 = DivideCurve(Curve=crv_2, Count=number_slider, Kinks=False)  # -> Points, Tangents, Parameters
eval = EvaluateCurve(Curve=reparameterize(crv_2), Parameter=Slider(0.312, range=0..1))  # -> Point, Tangent, Angle
eval_2 = EvaluateCurve(Curve=reparameterize(crv), Parameter=Slider(0.528, range=0..1))  # -> Point, Tangent, Angle
loft = Loft(Curves=[crv_2, crv], Options={Adjust=False, Closed=False, LoftEnds=0, LoftSimp=0, LoftType=0, Rebuild=10, Refit=0.01})
panel = Panel(divide.Points)
ln = Line(StartPoint=divide.Points, EndPoint=divide_2.Points)
ln_2 = Line(StartPoint=eval_2.Point, EndPoint=eval.Point)
