# Grasshopper definition Graft and Flip.gh (Grasshopper 1.0.7)

number_slider = Slider(12, range=0..100)
range = Range(Domain=Domain(0, 1), Steps=Slider(3, range=0..10))
range_2 = Range(Domain=Domain(0, 1), Steps=10)  # -> graft(Range)
number_slider_2 = Slider(2, range=0..10)
dom = ConstructDomain(DomainStart=0, DomainEnd=Slider(10, range=0..10))
dom_2 = ConstructDomain(DomainStart=Slider(12, range=12..25), DomainEnd=Slider(5, range=0..10))
panel = Panel(range_2)
pt = ConstructPoint(XCoordinate=number_slider, YCoordinate=number_slider, ZCoordinate=0)
graft = GraftTree(Tree=range_2, IncludeEmptyLists=True, IncludeNullItems=True)
pt_2 = ConstructPoint(XCoordinate=range_2, YCoordinate=range, ZCoordinate=0)
range_3 = Range(Domain=dom, Steps=number_slider_2)
range_4 = Range(Domain=dom_2, Steps=number_slider_2)
flip = FlipMatrix(Data=pt_2)
rec_2pt = Rectangle2Pt(Plane=PlaneXY(0, 0, 0), PointA=Point(0, 0, 0), PointB=pt, Radius=0)  # -> Rectangle, Length
pt_3 = ConstructPoint(XCoordinate=0, YCoordinate=0, ZCoordinate=range_3)
pline = PolyLine(Vertices=flip, Closed=False)
move = Move(Geometry=rec_2pt.Rectangle, Motion=Vector(0, 0, 10))  # -> Geometry, Transform
panel_2 = Panel(pline)
circle = CircleCNR(Center=pt_3, Normal=Vector(0, 0, 1), Radius=range_4)
viewer = ParamViewer(pline)
explode = Explode(Curve=rec_2pt.Rectangle, Recursive=True)  # -> graft(Segments), Vertices
explode_2 = Explode(Curve=move.Geometry, Recursive=True)  # -> graft(Segments), Vertices
divide = DivideCurve(Curve=circle, Count=10, Kinks=False)  # -> Points, Tangents, Parameters
flip_2 = FlipMatrix(Data=divide.Points)
merge = Merge(Data1=explode_2.Segments, Data2=explode.Segments)
pline_2 = PolyLine(Vertices=flip_2, Closed=False)
loft = Loft(Curves=merge, Options={Adjust=False, Closed=False, LoftEnds=0, LoftSimp=0, LoftType=0, Rebuild=10, Refit=0.01})  # -> flatten(Loft)
panel_3 = Panel(merge)
panel_4 = Panel(loft)
