# Grasshopper definition Graphmapper and Expressions (functions).gh (Grasshopper 1.0.7)

number_slider = Slider(6, range=0..10)
neg = Negative(Value=number_slider)
range = Range(Domain=Domain(0, 1), Steps=10)
number_slider_2 = Slider(4, range=0..10)
dom = ConstructDomain(DomainStart=neg, DomainEnd=number_slider)
graph = GraphMapper(
    range,
    x0=0,
    x1=1,
    y0=0,
    y1=1,
    container_name="Bezier",
    cpx=[0, 0.08318848908, 0.8556520939, 1],
    cpy=[0, 0.4150724411, 0.310077548, 1])
range_2 = Range(Domain=dom, Steps=Slider(20, range=0..100))
expression = Expression(x=range, Expression="x²")
expression_2 = Expression(x=graft(range_2), y=range_2, Expression="(x²+y²)/4")
lng = ListLength(List=range_2)
pt = ConstructPoint(XCoordinate=range, YCoordinate=expression, ZCoordinate=0)
eval = Evaluate(F="(cos(x)+cos(y))", x=graft(range_2), y=range_2, scale=number_slider_2)
eval_2 = Evaluate(F="(x²+y²)/scale", x=graft(range_2), y=range_2, scale=number_slider_2)
addition = Addition(A=eval, B=eval_2)
pt_2 = ConstructPoint(XCoordinate=graft(range_2), YCoordinate=range_2, ZCoordinate=addition)
neg_2 = Negative(Value=pt_2)
srfgrid = SurfaceFromPoints(Points=flatten(neg_2), UCount=lng, Interpolate=False)
