# Grasshopper definition Lifting Machines KCAI 001.gh (Grasshopper 1.0.7)

# ---- group: 2x6x12
number_slider = Slider(5, range=0..6)
dom = ConstructDomain(DomainStart=Slider(0, range=0..100), DomainEnd=Slider(144, range=0..144))
range = Range(Domain=dom, Steps=Slider(12, range=0..100))
pt = ConstructPoint(XCoordinate=range, YCoordinate=0, ZCoordinate=0)
pt_2 = ConstructPoint(XCoordinate=range, YCoordinate=0, ZCoordinate=0)
Z = UnitZ(Factor=number_slider)
move = Move(Geometry=pt, Motion=Z)  # -> Geometry, Transform
ln = Line(StartPoint=pt_2, EndPoint=move.Geometry)
pline = PolyLine(Vertices=move.Geometry, Closed=False)
Y = UnitY(Factor=Slider(2, range=0..2))
extr = Extrude(Base=ln, Direction=Y)
loft = Loft(Curves=extr, Options={Adjust=False, Closed=False, LoftEnds=0, LoftSimp=0, LoftType=0, Rebuild=10, Refit=0.01})
cap = CapHoles(Brep=loft)

# ----
merge = Merge(Data1=cap, Data2=cap, Data3=cap, Data4=cap, Data5=cap, Data6=cap, Data7=cap)
geo = Geometry(merge)
geo_2 = Geometry(merge)
geo_3 = Geometry(merge)
geo_4 = Geometry(merge)
geo_5 = Geometry(merge)
geo_6 = Geometry(merge)

# ---- group: Wheel
cir = Circle(Plane=PlaneXY(0, 0, 0), Radius=Slider(8, range=2..8))
Z_2 = UnitZ(Factor=Slider(4, range=0..8))
extr_2 = Extrude(Base=cir, Direction=Z_2)
xz = XZPlane(Origin=Point(0, 0, 0))
cap_2 = CapHoles(Brep=extr_2)
rotate = Rotate(Geometry=cap_2, Angle=1.570796327, Plane=xz)  # -> Geometry, Transform
xy = XYPlane(Origin=Point(0, 0, 0))
rotate_2 = Rotate(Geometry=rotate.Geometry, Angle=1.570796327, Plane=xy)  # -> Geometry, Transform

# ----
merge_2 = Merge(Data1=rotate_2.Geometry, Data2=rotate_2.Geometry, Data3=rotate_2.Geometry)

# ---- group: Wheels on Main Boom
geo_7 = Geometry(merge_2)
geo_8 = Geometry(merge_2)
Z_3 = UnitZ(Factor=number_slider)
Z_4 = UnitZ(Factor=number_slider)
move_2 = Move(Geometry=geo_7, Motion=Z_3)  # -> Geometry, Transform
move_3 = Move(Geometry=geo_8, Motion=Z_4)  # -> Geometry, Transform
X = UnitX(Factor=Slider(140, range=72..140))
X_2 = UnitX(Factor=Slider(72, range=72..140))
move_4 = Move(Geometry=move_2.Geometry, Motion=X)  # -> Geometry, Transform
move_5 = Move(Geometry=move_3.Geometry, Motion=X_2)  # -> Geometry, Transform

# ----
number_slider_2 = Slider(13, range=4..24)
Y_2 = UnitY(Factor=number_slider_2)
Y_3 = UnitY(Factor=number_slider_2)
neg = Negative(Value=Y_3)

# ---- group: Boom
geo_9 = Geometry(merge)
X_3 = UnitX(Factor=Slider(120, range=0..120))
Z_5 = UnitZ(Factor=Slider(6, range=0..6))

# ----
merge_3 = Merge(Data1=geo_9, Data2=move_4.Geometry, Data3=move_5.Geometry)
sunion = SolidUnion(Breps=merge_3)

# ---- group: Boom (continued)
move_6 = Move(Geometry=sunion, Motion=X_3)  # -> Geometry, Transform
move_7 = Move(Geometry=move_6.Geometry, Motion=Z_5)  # -> Geometry, Transform

# ---- group: rotation
merge_4 = Merge(Data2=move_7.Geometry, Data4=geo_9)
sunion_2 = SolidUnion(Breps=merge_4)
xz_2 = XZPlane(Origin=Point(0, 0, 0))
rotate_3 = Rotate(Geometry=sunion_2, Angle=Slider(0.946, range=0..2), Plane=xz_2)  # -> Geometry, Transform

sunion_3 = SolidUnion(Breps=[move_7.Geometry, geo_9])
xz_3 = XZPlane(Origin=Point(0, 0, 0))
rotate_4 = Rotate(Geometry=sunion_3, Angle=Slider(0.802, range=0..2), Plane=xz_3)  # -> Geometry, Transform

sunion_4 = SolidUnion(Breps=[move_7.Geometry, geo_9])
xz_4 = XZPlane(Origin=Point(0, 0, 0))
rotate_5 = Rotate(Geometry=sunion_4, Angle=Slider(0.796, range=0..2), Plane=xz_4)  # -> Geometry, Transform

# ----
move_8 = Move(Geometry=rotate_4.Geometry, Motion=Y_2)  # -> Geometry, Transform
move_9 = Move(Geometry=rotate_5.Geometry, Motion=neg)  # -> Geometry, Transform
merge_5 = Merge(Data1=rotate_3.Geometry, Data2=move_8.Geometry, Data3=move_9.Geometry)
