# Grasshopper definition ListManipulation007.gh (Grasshopper 1.0.7)

geo = Geometry(<brep referenced from the Rhino model>)
crv = Curve(<curve referenced from the Rhino model>)
divide = DivideCurve(Curve=crv, Count=Slider(10, range=0..10), Kinks=False)  # -> Points, Tangents, Parameters
divide_2 = DivideDomain²(Domain=geo, UCount=Slider(6, range=0..10), VCount=Slider(10, range=0..10))
shatter = Shatter(Curve=crv, Parameters=divide.Parameters)
subsrf = Isotrim(Surface=geo, Domain=divide_2)
Z = UnitZ(Factor=Slider(10, range=0..10))
extr = Extrude(Base=shatter, Direction=Z)
panel = Panel(subsrf)
panel_2 = Panel("""0
-1
4
-2
0""")
arrlinear = LinearArray(Geometry=extr, Direction=Z, Count=Slider(10, range=0..10))  # -> Geometry, Transform
culln = CullNth(List=arrlinear.Geometry, CullFrequency=Slider(7, range=0..10))
cull = CullPattern(List=arrlinear.Geometry, CullPattern=panel_2)
