# Grasshopper definition Manipulating Lists KCAI 002.gh (Grasshopper 1.0.7)

# Duplicate Data
# Repeat Data
number_slider = Slider(6, range=0..10)
dom = ConstructDomain(DomainStart=Slider(0, range=0..10), DomainEnd=Slider(10, range=0..10))
dom_2 = ConstructDomain(DomainStart=Slider(2, range=0..10), DomainEnd=Slider(8, range=0..10))
series = Series(Start=Slider(2, range=0..10), Step=Slider(9, range=0..10), Count=Slider(7, range=0..10))
# Merge
# Weave Polyline
# Culling
crv = Curve(<curve referenced from the Rhino model>)
range = Range(Domain=dom, Steps=number_slider)
range_2 = Range(Domain=dom_2, Steps=Slider(8, range=0..10))
panel = Panel(range)
divide = DivideCurve(Curve=crv, Count=10, Kinks=False)  # -> Points, Tangents, Parameters
panel_2 = Panel("""0
1
1
0""")
pline = PolyLine(Vertices=divide.Points, Closed=False)
pt = ConstructPoint(XCoordinate=panel, YCoordinate=0, ZCoordinate=0)
pt_2 = ConstructPoint(XCoordinate=panel, YCoordinate=Slider(10, range=0..10), ZCoordinate=0)
explode = Explode(Curve=pline, Recursive=True)  # -> Segments, Vertices
Z = UnitZ(Factor=1)
merge = Merge(Data1=pt, Data2=pt_2)
weave = Weave(Pattern=panel_2, Stream0=pt, Stream1=pt_2, NullGaps=False)

# ---- group: repeat data
repeat = RepeatData(Data=panel, Length=Slider(12, range=0..100))

# ----
dup = DuplicateData(Number=Slider(3, range=0..10), Order=Toggle(True))
extr = Extrude(Base=explode.Segments, Direction=Z)
pline_2 = PolyLine(Vertices=merge, Closed=False)
pline_3 = PolyLine(Vertices=weave, Closed=False)
panel_3 = Panel("""1
3
4""")
arrlinear = LinearArray(Geometry=extr, Direction=Z, Count=10)  # -> Geometry, Transform
panel_4 = Panel(repeat)

# ---- group: Cull nth
culln = CullNth(List=arrlinear.Geometry, CullFrequency=Slider(3, range=0..10))

# ----
cull_i = CullIndex(List=arrlinear.Geometry, Indices=panel_3, Wrap=True)
cull = CullPattern(List=arrlinear.Geometry, CullPattern=[False, False, True, True])
