# Grasshopper definition My Best 002.gh (Grasshopper 1.0.7)

number_slider = Slider(52, range=0..100)
pt = Point(Point(14.4860625, 30.9450405, 124.3207363))
pt_2 = Point(Point(-6.507596868, 14, 0))
pt_3 = Point(Point(14, 1.704345139, -4.292795977))
pt_4 = Point(Point(26.48679076, 14.46325679, 43.56397838))
srf4pt = _4PointSurface(CornerA=pt, CornerB=pt_2, CornerC=pt_3, CornerD=pt_4)
Y = UnitY(Factor=number_slider)
Z = UnitZ(Factor=number_slider)
sdivide = DivideSurface(Surface=srf4pt, UCount=10, VCount=10)  # -> Points, Normals, Parameters
move = Move(Geometry=sdivide.Points, Motion=Y)  # -> Geometry, Transform
ln = Line(StartPoint=sdivide.Points, EndPoint=move.Geometry)
