# Grasshopper definition My Best Yet...gh (Grasshopper 1.0.7)

X = UnitX(Factor=1)
line = LineSDL(Start="0,0,0", Direction=X, Length=Slider(19, range=0..200))
divide = DivideCurve(Curve=line, Count=Slider(19, range=0..100), Kinks=False)  # -> Points, Tangents, Parameters
pline = PolyLine(Vertices=divide.Points, Closed=False)
Z = UnitZ(Factor=Slider(20, range=0..100))
extr = Extrude(Base=pline, Direction=Z)
boundary = BoundarySurfaces(Edges=extr)
number_slider = Slider(28, range=0..100)
sdivide = DivideSurface(Surface=boundary, UCount=Slider(5, range=0..100), VCount=Slider(3, range=0..100))  # -> Points, Normals, Parameters
Y = UnitY(Factor=number_slider)
Y_2 = UnitY(Factor=1)
debrep = DeconstructBrep(Brep=boundary)  # -> Faces, Edges, Vertices
extr_2 = Extrude(Base=boundary, Direction=Y)
line_2 = LineSDL(Start=sdivide.Points, Direction=Y_2, Length=number_slider)
geo = Geometry(debrep.Edges)
geo_2 = Geometry(debrep.Faces)
geo_3 = Geometry(debrep.Vertices)
bbox = BoundingBox(Content=extr_2, Plane=PlaneXY(0, 0, 0))  # -> Box, Box_2
extr_3 = Extrude(Base=line_2, Direction=Y_2)
