# Grasshopper definition My First Bounce Kangaroo 2 Solver KCAI 001.gh (Grasshopper 1.0.7)
# plug-ins: Kangaroo2 Components

mplane = MeshPlane(Boundary={Plane=PlaneXY(0, 0, 0), Size=Domain2(u=-10..10, v=-10..10)}, WidthCount=10, HeightCount=10)  # -> Mesh, Area
medges = MeshEdges(Mesh=mplane.Mesh)  # -> NakedEdges, InteriorEdges, NonManifoldEdges
mc = MeshCorners(Mesh=mplane.Mesh, Angle=2.35619449)
len = Length(Curve=medges.NakedEdges)
merge = Merge(Data1=medges.NakedEdges, Data2=medges.InteriorEdges)
anchor = Anchor(Point=mc, Strength=10000)
Z = UnitZ(Factor=Slider(0.596, range=0..1))
demesh = DeconstructMesh(Mesh=mplane.Mesh)  # -> Vertices, Faces, Colours, Normals
multiplication = Multiplication(A=len, B=Slider(1, range=0..1))
grab = Grab(On=True, Strength=1, Range=3)  # -> Grab, Anchors
show = Show(G=mplane.Mesh)
length_line = LengthLine(Line=merge, Length=multiplication, Strength=10)
load = Load(Point=demesh.Vertices, ForceVector=Z)
button = Button()
merge_2 = Merge(Data1=length_line, Data2=load, Data3=anchor, Data4=show, Data5=grab.Grab)
stepsolver = StepSolver(Tolerance=0.01, Momentum=False, Damping=0.99, SubIterations=10, Animate=Slider(0.255, range=0..1))  # -> I, V, O
bouncysolver = BouncySolver(
    GoalObjects=merge_2,
    Reset=Button(),
    Threshold=1e-15,
    Tolerance=0.01,
    Damping=0.99,
    Iterations=Slider(1, range=1..100),
    On=True)  # -> I, V, O
solver = Solver(Reset=False, Threshold=1e-15, Tolerance=0.01, On=True)  # -> I, V, O
geo = Geometry(bouncysolver.O)
