# Grasshopper definition Parametric Wheel WSII 001.gh (Grasshopper 1.0.7)

width_of_wheel = Slider(11, range=1..20)
width_of_wheel_2 = Slider(9, range=1..20)
number_slider = Slider(4, range=2..10)
# Parametric Wheel (cylinder)
rholes = Slider(7, range=0..10)
number_slider_2 = Slider(27, range=23..40)
# Parametric Wheel (cones)
number_slider_3 = Slider(38, range=27..60)
circle = Circle({Plane=Plane(origin=(0, 0, 0), x=(0.1788854382, 0.9838699101, 0), y=(-0.9838699101, 0.1788854382, 0)), Radius=22.36067977})
cyl = Cylinder(Base=PlaneXY(0, 0, 0), Radius=rholes, Length=width_of_wheel_2)
cone = Cone(Base=PlaneXY(0, 0, 0), Radius=rholes, Length=width_of_wheel)  # -> Cone, Tip
cyl_2 = Cylinder(Base=PlaneXY(0, 0, 0), Radius=number_slider_3, Length=width_of_wheel_2)
cone_2 = Cone(Base=PlaneXY(0, 0, 0), Radius=number_slider_3, Length=width_of_wheel)  # -> Cone, Tip
X = UnitX(Factor=number_slider_2)
X_2 = UnitX(Factor=number_slider_2)
cap = CapHoles(Brep=cyl)
cap_2 = CapHoles(Brep=cone.Cone)
# Hybrid Wheel (Cyl/Cone)
cap_3 = CapHoles(Brep=cyl_2)
cap_4 = CapHoles(Brep=cone_2.Cone)
move = Move(Geometry=cap, Motion=X)  # -> Geometry, Transform
move_2 = Move(Geometry=cap_2, Motion=X_2)  # -> Geometry, Transform
arrcurve = CurveArray(Geometry=move.Geometry, Curve=circle, Count=number_slider)  # -> Geometry, Transform
arrcurve_2 = CurveArray(Geometry=move_2.Geometry, Curve=cone_2.Cone, Count=number_slider)  # -> Geometry, Transform
sdiff = SolidDifference(BrepsA=cap_4, BrepsB=arrcurve_2.Geometry)
sdiff_2 = SolidDifference(BrepsA=cap_3, BrepsB=arrcurve.Geometry)
sdiff_3 = SolidDifference(BrepsA=sdiff_2, BrepsB=sdiff)
