# Grasshopper definition Random and Sort.gh (Grasshopper 1.0.7)

number_slider = Slider(7, range=0..10)
number_slider_2 = Slider(8, range=0..10)
crv = Curve([<curve referenced from the Rhino model> x4])
range = Range(Domain=Domain(0, 1), Steps=10)
crv_2 = Curve([<curve referenced from the Rhino model> x4])
area = Area(Geometry=crv)  # -> Area, Centroid
crv_3 = Curve(<curve referenced from the Rhino model>)
random = Random(Range=Domain(0, 1), Number=number_slider, Seed=number_slider_2)
series = Series(Start=number_slider_2, Step=1, Count=number_slider_2)
jitter = Jitter(List=series, Jitter=Slider(8, range=0..10), Seed=2)  # -> Values, Indices
random_2 = Random(Range=Domain(0, 1), Number=number_slider, Seed=2)
alongcrv = SortAlongCurve(Points=area.Centroid, Curve=crv_3)  # -> Points, Indices
area_2 = Area(Geometry=crv_2)  # -> Area, Centroid
panel = Panel(random)
sort = SortList(Keys=panel, ValuesA=random_2)  # -> Keys, ValuesA
sort_2 = SortList(Keys=alongcrv.Indices, ValuesA=crv)  # -> Keys, ValuesA
panel_2 = Panel(alongcrv.Points)
pdecon = Deconstruct(Point=area_2.Centroid)  # -> XComponent, YComponent, ZComponent
panel_3 = Panel(jitter.Values)
panel_4 = Panel(sort.Keys)
loft = Loft(Curves=sort_2.ValuesA, Options={Adjust=False, Closed=False, LoftEnds=0, LoftSimp=0, LoftType=0, Rebuild=10, Refit=0.01})
sort_3 = SortList(Keys=pdecon.ZComponent, ValuesA=crv_2)  # -> Keys, ValuesA
panel_5 = Panel(sort_2.Keys)
panel_6 = Panel(loft)
panel_7 = Panel(pdecon.ZComponent)
loft_2 = Loft(Curves=sort_3.ValuesA, Options={Adjust=False, Closed=False, LoftEnds=0, LoftSimp=0, LoftType=0, Rebuild=10, Refit=0.01})
