# Grasshopper definition Sine Functions and Transformations.gh (Grasshopper 1.0.7)

# guarentees a sq set of points
# on surface, no half holes
crv = Curve(<curve referenced from the Rhino model>)
pi = Pi(Factor=Slider(2, range=0..12))
srf = Surface(crv)
number_slider = Slider(43, range=0..100)
range = Range(Domain=pi, Steps=Slider(360, range=0..360))
dim = Dimensions(Surface=srf)  # -> UDimension, VDimension
area = Area(Geometry=srf)  # -> Area, Centroid
expression = Expression(w=graft([Slider(1, range=0..2), Slider(0.5, range=0..2), Slider(0.25, range=0..2)]), t=range, Expression="sin(w*t)")
division = Division(A=dim.UDimension, B=dim.VDimension)
md_slider = MDSlider(
    SliderMode=0,
    slider_value=Point(0.5401719256, 0.2245334532, 0.5),
    x_domain=Domain(0, 1),
    y_domain=Domain(0, 1),
    z_domain=Domain(0, 1))
md_slider_2 = MDSlider(
    SliderMode=0,
    slider_value=Point(0.1441892298, 0.9533711875, 0.5),
    x_domain=Domain(0, 1),
    y_domain=Domain(0, 1),
    z_domain=Domain(0, 1))
scale = Scale(Geometry=srf, Center=area.Centroid, Factor=Slider(3.478, range=0..5))  # -> Geometry, Transform
multiplication = Multiplication(A=division, B=number_slider)
flip = FlipMatrix(Data=expression)
viewer = ParamViewer(flip)
int = Integer(multiplication)
ma = MassAddition(Input=flip)  # -> flatten(Result), PartialResults
ma_2 = MassMultiplication(Input=flip)  # -> Result, PartialResults
md_slider_3 = MDSlider(
    SliderMode=0,
    slider_value=Point(0.758053798, 0.3364762142, 0.5),
    x_domain=Domain(0, 1),
    y_domain=Domain(0, 1),
    z_domain=Domain(0, 1))
evalsrf = EvaluateSurface(Surface=reparameterize(scale.Geometry), Point=[md_slider_2, md_slider, md_slider_3])  # -> Point, Normal, UDirection, VDirection, Frame
sdivide = DivideSurface(Surface=srf, UCount=int, VCount=number_slider)  # -> flatten(Points), Normals, Parameters
dist = Distance(PointA=graft(evalsrf.Point), PointB=sdivide.Points)
pt = ConstructPoint(XCoordinate=range, YCoordinate=ma.Result, ZCoordinate=0)
intcrv = Interpolate(Vertices=pt, Degree=3, Periodic=False, KnotStyle=1)  # -> Curve, Length, Domain
expression_2 = Expression(w=flatten(Slider(0.662, range=0..2)), t=dist, Expression="sin(2*w^2*t)")
flip_2 = FlipMatrix(Data=expression_2)
ma_3 = MassMultiplication(Input=flip_2)  # -> flatten(Result), PartialResults
multiplication_2 = Multiplication(A=Slider(8.275, range=0..10), B=ma_3.Result)
Z = UnitZ(Factor=multiplication_2)
expression_3 = Expression(u=int, Expression="u+1")
move = Move(Geometry=sdivide.Points, Motion=Z)  # -> Geometry, Transform
srfgrid = SurfaceFromPoints(Points=move.Geometry, UCount=expression_3, Interpolate=False)
