# Grasshopper definition Spiraling KCAI 006.gh (Grasshopper 1.0.7)

# Point Polar
# Range
# Pi
# Number of Pi
# Into xy plane
# Golden Mean into d (offset)
# Convert Degrees in to Radians
# Create a surface from lines not Points
# ------
# Spline Curves
# Planar and NonPlanar
# Point on curve Analysis
number_slider = Slider(60, range=0..60)
pi = Pi(Factor=Slider(4, range=1..4))

# ---- group: t
range = Range(Domain=pi, Steps=Slider(29, range=1..100))

# ----
rad = Radians(Degrees=number_slider)
phi = GoldenRatio(Factor=range)

# ---- group: NonPlanar
pt = PointPolar(BasePlane=PlaneXY(0, 0, 0), XYAngle=range, ZAngle=rad, Offset=phi)

# ---- group: planar
pt_2 = PointPolar(BasePlane=PlaneXY(0, 0, 0), XYAngle=range, ZAngle=0, Offset=phi)

# ---- group: Connecting Points
ln = Line(StartPoint=pt_2, EndPoint=pt)

# ----
nurbs = NurbsCurve(Vertices=pt, Degree=3, Periodic=False)  # -> Curve, Length, Domain
nurbs_2 = NurbsCurve(Vertices=pt_2, Degree=3, Periodic=False)  # -> Curve, Length, Domain

# ---- group: Lofted Surface
loft = Loft(Curves=ln, Options={Adjust=False, Closed=False, LoftEnds=0, LoftSimp=0, LoftType=0, Rebuild=10, Refit=0.01})

# ----
curvepoint = PointOnCurve(nurbs_2.Curve, parameter=0.558)
panel = Panel(curvepoint)
