# Grasshopper definition Srf4Point KCAI 001.gh (Grasshopper 1.0.7)

# ---- group: Srf4Point
pt = Point(<point referenced from the Rhino model>)
# Start with 4 Points in Rhino
# Control/Spacebar for Setting Choices
# Note Data Trees in Param Viewer
# Bake
# Save both GH and 3dm files (or enter 4 points)
pt_2 = Point(<point referenced from the Rhino model>)
pt_3 = Point(<point referenced from the Rhino model>)
pt_4 = Point(<point referenced from the Rhino model>)
srf4pt = _4PointSurface(CornerA=pt, CornerB=pt_3, CornerC=pt_4, CornerD=pt_2)

# ---- group: Divide/Move/LinebtwPoints
pt_5 = Point(<point referenced from the Rhino model>)
pt_6 = Point(<point referenced from the Rhino model>)
pt_7 = Point(<point referenced from the Rhino model>)
pt_8 = Point(<point referenced from the Rhino model>)
srf4pt_2 = _4PointSurface(CornerA=pt_5, CornerB=pt_6, CornerC=pt_7, CornerD=pt_8)
Z = UnitZ(Factor=Slider(15, range=0..100))
sdivide = DivideSurface(Surface=srf4pt_2, UCount=10, VCount=10)  # -> simplify(graft(Points)), Normals, Parameters
move = Move(Geometry=sdivide.Points, Motion=Z)  # -> Geometry, Transform
ln = Line(StartPoint=sdivide.Points, EndPoint=move.Geometry)

# ----
panel = Panel(sdivide.Points)
viewer = ParamViewer(sdivide.Points)
