# Grasshopper definition Surface Primitives KCAI 002.gh (Grasshopper 1.0.7)

# ---- group: Cylinder
# Set Number on Blocks
# R N
# Digits
# Expression Editor Change to X variable all the time!
number_slider = Slider(18, range=0..100)
cyl = Cylinder(Base=PlaneXY(0, 0, 0), Radius=Slider(19, range=0..100), Length=number_slider)

# ----
list = ValueList({"One": 1, "Two": 2, "Three": 2² - 1, "Four": Sqrt(16)}, selected="One")

# ---- group: Cylinder
number_slider_2 = Slider(21, range=0..100)
number_slider_3 = Slider(19, range=0..100)
cyl_2 = Cylinder(Base=PlaneXY(0, 0, 0), Radius=expr("x/10", number_slider_2), Length=number_slider_2)
