# Grasshopper definition Sweep and Rail KCAI 003.gh (Grasshopper 1.0.7)

# ---- group: Realign end points of curves
toggle = BooleanToggle(True)

# ----
crv = Curve()
crv_2 = Curve()
crv_3 = Curve()
crv_4 = Curve()
crv_5 = Curve()
crv_6 = Curve([<curve referenced from the Rhino model> x3])
crv_7 = Curve([<curve referenced from the Rhino model> x2])
loft_opt = LoftOptions(Closed=False, Adjust=toggle, Rebuild=0, Refit=0, Type=0)
swp1 = Sweep1(Rail=crv, Sections=crv_3, Miter=1)

# ---- group: How to Flip Automatically
flip = Flip(Surface=crv_4, Guide=crv_2)  # -> Surface, Result

# ---- group: loft options
loft_opt_2 = LoftOptions(Closed=Toggle(False), Adjust=False, Rebuild=0, Refit=0, Type=Slider(5, range=1..5))

# ----
loft = Loft(Curves=crv_7, Options=loft_opt)
loft_2 = Loft(Curves=crv_6, Options=loft_opt_2)
swp2 = Sweep2(Rail1=flip.Surface, Rail2=crv_2, Sections=crv_5, SameHeight=Toggle(True))
