# Grasshopper definition The Single, Multiple, Many KCAI 004.gh (Grasshopper 1.0.7)

# ----
# Point Move Line Divide
# Double Line = List
# Dashed Line = Tree
# Shortest, Longest, Cross Reference List Algorithms
number_slider = Slider(48, range=0..100)
pt = Point(<point referenced from the Rhino model>)
Y = UnitY(Factor=number_slider)
move = Move(Geometry=pt, Motion=Y)  # -> Geometry, Transform
X = UnitX(Factor=Slider(31, range=0..100))

# ---- group: Line A
lna = Line(StartPoint=pt, EndPoint=move.Geometry)

# ---- group: Line B
move_2 = Move(Geometry=lna, Motion=X)  # -> Geometry, Transform

# ----
divide = DivideCurve(Curve=lna, Count=Slider(25, range=0..100), Kinks=False)  # -> Points, Tangents, Parameters
divide_2 = DivideCurve(Curve=move_2.Geometry, Count=Slider(10, range=0..100), Kinks=False)  # -> Points, Tangents, Parameters
ln = Line(StartPoint=divide.Points, EndPoint=divide_2.Points)

viewer = ParamViewer(divide_2.Points)
viewer_2 = ParamViewer(divide.Tangents)
panel = Panel(divide_2.Points)
panel_2 = Panel(divide.Points)
crossref = CrossReference(ListA=divide.Points, ListB=divide_2.Points, CrossMode=1)  # -> ListA, ListB
short = ShortestList(ListA=divide.Points, ListB=divide_2.Points, TrimMode=2)  # -> ListA, ListB
long = LongestList(ListA=divide.Points, ListB=divide_2.Points, PaddingMode=2)  # -> ListA, ListB
ln_2 = Line(StartPoint=short.ListA, EndPoint=short.ListB)
ln_3 = Line(StartPoint=long.ListA, EndPoint=long.ListB)
ln_4 = Line(StartPoint=crossref.ListA, EndPoint=crossref.ListB)
