# Grasshopper definition Trees Flatten.gh (Grasshopper 1.0.7)

pt = Point(<point referenced from the Rhino model>)
pt_2 = Point(<point referenced from the Rhino model>)
ln = Line(StartPoint=pt_2, EndPoint=pt)
divide = DivideCurve(Curve=ln, Count=Slider(4, range=0..10), Kinks=False)  # -> Points, Tangents, Parameters
panel = Panel(divide.Points)
shatter = Shatter(Curve=ln, Parameters=divide.Parameters)
Z = UnitZ(Factor=Slider(3, range=0..10))
extr = Extrude(Base=shatter, Direction=Z)
arrlinear = LinearArray(Geometry=extr, Direction=Z, Count=Slider(3, range=0..10))  # -> Geometry, Transform
panel_2 = Panel(arrlinear.Geometry)
viewer = ParamViewer(arrlinear.Geometry)
debrep = DeconstructBrep(Brep=arrlinear.Geometry)  # -> Faces, Edges, Vertices
panel_3 = Panel(debrep.Faces)
geo = Geometry(simplify(debrep.Faces))
viewer_2 = ParamViewer(geo)
panel_4 = Panel(geo)
