# Grasshopper definition Trig Curves + Lists DomRan KCAI 005.gh (Grasshopper 1.0.7)

# Range in Set/Sequence
# Points
# Sine and Cosine
# Spline instead of Line
number_slider = Slider(37, range=0..100)
range = Range(Domain=Slider(13, range=0..100), Steps=number_slider)
sin = Sine(Value=range)
cos = Cosine(Value=range)
pt = ConstructPoint(XCoordinate=range, YCoordinate=sin, ZCoordinate=cos)
nurbs = NurbsCurve(Vertices=pt, Degree=3, Periodic=False)  # -> Curve, Length, Domain
