# Grasshopper definition Weaving Patterns.gh (Grasshopper 1.0.7)

crv = Curve(<curve referenced from the Rhino model>)
crv_2 = Curve(<curve referenced from the Rhino model>)
number_slider = Slider(9, range=0..20)
number_slider_2 = Slider(5, range=0..20)
pipe = Pipe(Curve=crv, Radius=Slider(17.394, range=0..30), Caps=0)
sdivide = DivideSurface(Surface=pipe, UCount=number_slider_2, VCount=number_slider)  # -> Points, Normals, Parameters
flip = FlipMatrix(Data=sdivide.Normals)
flip_2 = FlipMatrix(Data=sdivide.Points)
srf = Surface(crv_2)
sdivide_2 = DivideSurface(Surface=srf, UCount=number_slider_2, VCount=number_slider)  # -> Points, Normals, Parameters
sdivide_3 = DivideSurface(Surface=pipe, UCount=number_slider_2, VCount=number_slider)  # -> Points, Normals, Parameters
panel = Panel("""true
false""")
not = GateNot(A=panel)
cull = CullPattern(List=sdivide_3.Points, CullPattern=not)
cull_2 = CullPattern(List=sdivide_3.Normals, CullPattern=not)
cull_3 = CullPattern(List=sdivide_3.Points, CullPattern=not)
cull_4 = CullPattern(List=sdivide_3.Normals, CullPattern=not)
cull_5 = CullPattern(List=flip_2, CullPattern=not)
cull_6 = CullPattern(List=flip, CullPattern=not)
cull_7 = CullPattern(List=flip_2, CullPattern=not)
cull_8 = CullPattern(List=flip, CullPattern=not)
cull_9 = CullPattern(List=sdivide_3.Normals, CullPattern=panel)
cull_10 = CullPattern(List=sdivide_3.Points, CullPattern=panel)
cull_11 = CullPattern(List=sdivide_3.Normals, CullPattern=panel)
cull_12 = CullPattern(List=sdivide_3.Points, CullPattern=panel)
not_2 = GateNot(A=not)
flip_3 = FlipMatrix(Data=cull)
flip_4 = FlipMatrix(Data=cull_2)
flip_5 = FlipMatrix(Data=cull_3)
flip_6 = FlipMatrix(Data=cull_4)
cull_13 = CullPattern(List=flip, CullPattern=panel)
cull_14 = CullPattern(List=flip_2, CullPattern=panel)
cull_15 = CullPattern(List=flip, CullPattern=panel)
cull_16 = CullPattern(List=flip_2, CullPattern=panel)
not_3 = GateNot(A=not)
flip_7 = FlipMatrix(Data=cull_5)
flip_8 = FlipMatrix(Data=cull_6)
flip_9 = FlipMatrix(Data=cull_7)
flip_10 = FlipMatrix(Data=cull_8)
number_slider_3 = Slider(10, range=0..10)
flip_11 = FlipMatrix(Data=cull_9)
flip_12 = FlipMatrix(Data=cull_10)
flip_13 = FlipMatrix(Data=cull_11)
flip_14 = FlipMatrix(Data=cull_12)
number_slider_4 = Slider(5.93, range=0..10)
flip_15 = FlipMatrix(Data=cull_13)
flip_16 = FlipMatrix(Data=cull_14)
number_slider_5 = Slider(10, range=0..10)
cull_17 = CullPattern(List=flip_3, CullPattern=not)
cull_18 = CullPattern(List=flip_4, CullPattern=not)
cull_19 = CullPattern(List=flip_5, CullPattern=not_2)
cull_20 = CullPattern(List=flip_6, CullPattern=not_2)
flip_17 = FlipMatrix(Data=cull_15)
flip_18 = FlipMatrix(Data=cull_16)
number_slider_6 = Slider(5.93, range=0..10)
cull_21 = CullPattern(List=flip_7, CullPattern=not)
cull_22 = CullPattern(List=flip_8, CullPattern=not)
cull_23 = CullPattern(List=flip_9, CullPattern=not_3)
cull_24 = CullPattern(List=flip_10, CullPattern=not_3)
cull_25 = CullPattern(List=flip_11, CullPattern=panel)
cull_26 = CullPattern(List=flip_12, CullPattern=panel)
cull_27 = CullPattern(List=flip_13, CullPattern=not)
cull_28 = CullPattern(List=flip_14, CullPattern=not)
cull_29 = CullPattern(List=flip_15, CullPattern=panel)
cull_30 = CullPattern(List=flip_16, CullPattern=panel)
amp = Amplitude(Vector=cull_18, Amplitude=number_slider_3)
cull_31 = CullPattern(List=flip_17, CullPattern=not)
cull_32 = CullPattern(List=flip_18, CullPattern=not)
amp_2 = Amplitude(Vector=cull_20, Amplitude=number_slider_3)
amp_3 = Amplitude(Vector=cull_22, Amplitude=number_slider_4)
amp_4 = Amplitude(Vector=cull_25, Amplitude=number_slider_5)
amp_5 = Amplitude(Vector=cull_24, Amplitude=number_slider_4)
amp_6 = Amplitude(Vector=cull_27, Amplitude=number_slider_5)
amp_7 = Amplitude(Vector=cull_29, Amplitude=number_slider_6)
neg = Negative(Value=amp)
amp_8 = Amplitude(Vector=cull_31, Amplitude=number_slider_6)
neg_2 = Negative(Value=amp_5)
neg_3 = Negative(Value=amp_6)
move = Move(Geometry=cull_17, Motion=neg)  # -> Geometry, Transform
move_2 = Move(Geometry=cull_19, Motion=amp_2)  # -> Geometry, Transform
neg_4 = Negative(Value=amp_7)
move_3 = Move(Geometry=cull_21, Motion=amp_3)  # -> Geometry, Transform
move_4 = Move(Geometry=cull_23, Motion=neg_2)  # -> Geometry, Transform
move_5 = Move(Geometry=cull_26, Motion=amp_4)  # -> Geometry, Transform
move_6 = Move(Geometry=cull_28, Motion=neg_3)  # -> Geometry, Transform
move_7 = Move(Geometry=cull_30, Motion=neg_4)  # -> Geometry, Transform
move_8 = Move(Geometry=cull_32, Motion=amp_8)  # -> Geometry, Transform
weave = Weave(Pattern=[0, 1], Stream0=move.Geometry, Stream1=move_2.Geometry, NullGaps=False)
weave_2 = Weave(Pattern=[0, 1], Stream0=move_3.Geometry, Stream1=move_4.Geometry, NullGaps=False)
weave_3 = Weave(Pattern=[0, 1], Stream0=move_5.Geometry, Stream1=move_6.Geometry, NullGaps=False)
weave_4 = Weave(Pattern=[0, 1], Stream0=move_7.Geometry, Stream1=move_8.Geometry, NullGaps=False)
intcrv = Interpolate(Vertices=weave, Degree=3, Periodic=False, KnotStyle=1)  # -> flatten(Curve), Length, Domain
intcrv_2 = Interpolate(Vertices=weave_2, Degree=3, Periodic=False, KnotStyle=1)  # -> flatten(Curve), Length, Domain
intcrv_3 = Interpolate(Vertices=weave_3, Degree=3, Periodic=False, KnotStyle=1)  # -> flatten(Curve), Length, Domain
intcrv_4 = Interpolate(Vertices=weave_4, Degree=3, Periodic=False, KnotStyle=1)  # -> flatten(Curve), Length, Domain
weave_5 = Weave(Pattern=[0, 1], Stream0=intcrv_4.Curve, Stream1=intcrv_2.Curve, NullGaps=False)
weave_6 = Weave(Pattern=[0, 1], Stream0=intcrv_3.Curve, Stream1=intcrv.Curve, NullGaps=False)
pipe_2 = Pipe(Curve=[weave_5, weave_6], Radius=1, Caps=0)
