# Grasshopper definition Wheel WSII 002.gh (Grasshopper 1.0.7)

# Wheel with sq holes WSII 002
# requires cylinder in Rhino
number_slider = Slider(24, range=1..40)
number_slider_2 = Slider(100, range=0..100)
cyl = Cylinder(Base=PlaneXY(0, 0, 0), Radius=number_slider, Length=number_slider_2)
cap = CapHoles(Brep=cyl)
debrep = DeconstructBrep(Brep=cap)  # -> Faces, Edges, Vertices
item = ListItem(List=debrep.Faces, Index=Slider(1, range=0..2), Wrap=True)
item_2 = ListItem(List=debrep.Edges, Index=Slider(0, range=0..2), Wrap=True)
item_3 = ListItem(List=debrep.Vertices, Index=Slider(0, range=0..1), Wrap=True)
sdivide = DivideSurface(Surface=item, UCount=Slider(5, range=0..100), VCount=Slider(8, range=0..100))  # -> flatten(Points), Normals, Parameters
number_slider_3 = Slider(3, range=0..10)
flip = FlipMatrix(Data=sdivide.Points)  # -> flatten(Data)
planesrf = PlaneSurface(Plane=flip, XSize=number_slider_3, YSize=number_slider_3)
Z = UnitZ(Factor=number_slider_2)
brep = Brep(planesrf)
neg = Negative(Value=Z)
extr = Extrude(Base=brep, Direction=neg)
sdiff = SolidDifference(BrepsA=cap, BrepsB=extr)
