# Grasshopper definition Writing Clean Code.gh (Grasshopper 1.0.7)

X = UnitX(Factor=1)
line = LineSDL(Start="0,0,0", Direction=X, Length=Slider(55, range=0..200))
divide = DivideCurve(Curve=line, Count=Slider(19, range=0..100), Kinks=False)  # -> Points, Tangents, Parameters
Z = UnitZ(Factor=Slider(29, range=0..100))
pline = PolyLine(Vertices=divide.Points, Closed=False)
extr = Extrude(Base=pline, Direction=Z)
